# Grasshopper definition get_points_on_surface.gh (Grasshopper 1.0.7)

panel = Panel("""0.5,0.5
0.1, 0.1
0.8, 0.8""")
srf = Surface(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)
evalsrf = EvaluateSurface(Surface=reparameterize(srf), Point=panel)  # -> Point, Normal, UDirection, VDirection, Frame
pt = Point(evalsrf.Point)
