# Grasshopper definition bpt2obj.gh (Grasshopper 1.0.7)

# ---- group: Set parameters
input_directory = Panel("C:\")
input_file_name = Panel("teapotCGA")

# ---- group: Push to write a .obj file
run = Button()

# ----
txt = Text([input_file_name, ".bpt"])
txt_2 = Text([input_file_name, ".obj"])
join = TextJoin(Text=txt_2)
join_2 = TextJoin(Text=txt)
input_file_name_2 = Panel(join_2)
output_file_name = Panel(join)
c_bpt2obj = CSharpScript(Directory=input_directory, InputFileName=input_file_name_2, OutputFileName=output_file_name, Run=run)  # -> out; inputs Directory: String, InputFileName: String, OutputFileName: String, Run: Boolean
# ---------- c_bpt2obj: C# usings ----------
using System.IO;
using System.Text;
# ---------- c_bpt2obj: C# ----------
    string inputFullPath = Directory + "/" + InputFileName;

    //Read .bpt file
    var list = new List<List<string>>();
    try{
      using (StreamReader sr = new StreamReader(inputFullPath, Encoding.GetEncoding("Shift_JIS")))
      {
        string line;
        while ((line = sr.ReadLine()) != null)
        {
          string[] strs = line.Split(' ');
          var slist = new List<string>();
          foreach(string s in strs){
            if(s != " " && s != ""){
              slist.Add(s);
            }
          }
          if (slist.Count != 0) list.Add(slist);
        }
        sr.Close();
      }
    }
    catch (Exception ex)
    {
      Print(ex.ToString());
    }

    //Construct data for obj
    var sb = new System.Text.StringBuilder();

    int patchNumber = int.Parse(list[0][0]);
    int id = 1;
    int cpIndex = 1;

    sb.AppendLine("# http://www.holmes3d.net/graphics/teapot/");
    sb.AppendLine("# bpt2obj");
    for(int i = 0; i < patchNumber; ++i){

      int udeg = int.Parse(list[id][0]);
      int vdeg = int.Parse(list[id][1]);

      int uCPLength = udeg + 1;
      int vCPLength = vdeg + 1;
      int cpLength = uCPLength * vCPLength;

      id++;
      //control points
      for(int j = 0; j < cpLength; ++j){
        sb.Append("v ");
        sb.Append(double.Parse(list[id][0]));
        sb.Append(" ");
        sb.Append(double.Parse(list[id][1]));
        sb.Append(" ");
        sb.Append(double.Parse(list[id][2]));
        sb.Append("\n");
        id++;
      }
      sb.AppendLine("cstype bspline");
      sb.AppendLine("deg " + udeg.ToString() + " " + vdeg.ToString());
      sb.Append("surf 0 1 0 1");
      for(int j = 0; j < cpLength; ++j){
        sb.Append(" " + cpIndex.ToString());
        cpIndex++;
      }
      sb.Append("\n");
      
      //u knot vector
      sb.Append("parm u");
      for(int j = 0; j <= udeg; ++j){
        sb.Append(" 0");
      }
      for(int j = 0; j <= udeg; ++j){
        sb.Append(" 1");
      }
      sb.Append("\n");

      //v knot vector
      sb.Append("parm v");
      for(int j = 0; j <= udeg; ++j){
        sb.Append(" 0");
      }
      for(int j = 0; j <= udeg; ++j){
        sb.Append(" 1");
      }
      sb.Append("\n");

      sb.AppendLine("end");
    }

    Print(sb.ToString());

    //Write as obj file format
    string outputFullPath = Directory + "/" + OutputFileName;
    if(Run){
      try{
        using (StreamWriter sw = new StreamWriter(outputFullPath, false, Encoding.UTF8))
        {
          sw.Write(sb.ToString());
        }
      }
      catch (Exception ex)
      {
        Print(ex.ToString());
      }
    }
# ---------- end c_bpt2obj ----------
panel = Panel(c_bpt2obj)
